# Dynamo graph Place Opening on Linked Window or Door.dyn "Opening_From_LinkedModel" (Dynamo 2.19.3.6394)
# packages: Rhythm 2022.11.4, bimorphNodes 5.1.3

# group: Parameters
# Select linked file containing doors and windows
# Select wall opening to be placed
links = Links("2024-06-03-BLDG 2 - MPR Fremont_R23_detached.rvt : 22 : location <Not Shared>")
family_for_opening = FamilyTypes("Opening For Ducts:Base")  # graph input

# group: Collect Linked Windows/Doors
code_block = CodeBlock { Category.ByName("Windows"); Category.ByName("Doors"); }
ofCategory = Revit.LinkElement.OfCategory(linkInstance=links, category=code_block.out0)
element = Revit.LinkElement.Element(linkElement=ofCategory)
ofCategory_2 = Revit.LinkElement.OfCategory(linkInstance=links, category=code_block.out1)
element_2 = Revit.LinkElement.Element(linkElement=ofCategory_2)
join = List.Join(list0=ofCategory, list1=ofCategory_2)

# group: Collect Walls
code_block_2 = CodeBlock { Category.ByName("Walls"); }
all_elements_of_category = ElementsOfCategory(Category=code_block_2)

# group: Get Element/Wall Intersection Pairs
# Python Node returns list of elements [0] and list of corresponding walls [1]
intersectsElement = Revit.Element.IntersectsElement(elementSetA=join, elementSetB=all_elements_of_category)
element_3 = Results.ElementIntersectionResult.Element(elementIntersectionResult=intersectsElement)
intersectingElements = Results.ElementIntersectionResult.IntersectingElements(elementIntersectionResult=intersectsElement)
python_script = Python(IN[0]=element_3, IN[1]=intersectingElements)  # CPython3
# ---------- python_script.python (21 lines) ----------
# Load the Python Standard and DesignScript Libraries
import sys
import clr
clr.AddReference('ProtoGeometry')
from Autodesk.DesignScript.Geometry import *

# The inputs to this node will be stored as a list in the IN variables.
elements = IN[0]
walls = IN[1]
outputelem = []
outputwall = []

# Place your code below this line
for index, wall in enumerate(walls):
    if wall:
        outputelem.append(elements[index])
        outputwall.append(wall[0])


# Assign your output to the OUT variable.
OUT = [outputelem, outputwall]
# ----------------------------------------

code_block_3 = CodeBlock { 0; 1; }
getItemAtIndex = List.GetItemAtIndex(list=python_script, index=code_block_3.out1)
getItemAtIndex_2 = List.GetItemAtIndex(list=python_script, index=code_block_3.out0)

# group: Place Opening
# Creates wall opening at position of window/door
location = Revit.LinkElement.Location(linkElement=getItemAtIndex_2)
byHostAndPoint = FamilyInstance.ByHostAndPoint(familyType=family_for_opening, host=getItemAtIndex, point=location)

# group: Scale Opening to Fit
code_block_4 = CodeBlock { "Height"; "Width"; }
ʳʰʸᵗʰᵐ_elements = Rhythm.Revit.Elements.Elements.GetParameterValueByNameTypeOrInstance(element=getItemAtIndex_2, parameterName=code_block_4.out0)
setParameterByName = Element.SetParameterByName(element=byHostAndPoint, parameterName=code_block_4.out0, value=ʳʰʸᵗʰᵐ_elements)
ʳʰʸᵗʰᵐ_elements_2 = Rhythm.Revit.Elements.Elements.GetParameterValueByNameTypeOrInstance(element=getItemAtIndex_2, parameterName=code_block_4.out1)
setParameterByName_2 = Element.SetParameterByName(element=byHostAndPoint, parameterName=code_block_4.out1, value=ʳʰʸᵗʰᵐ_elements_2)
